# Dynamo graph FaceOpening_CBWD_BL_Sync_Player.dyn
# Face Opening bottom Elevation → CBWD B.L. Dynamo Player ready. SelectionMode: SelectedOnly | AllOpenings. Revit 2023.

projectRoot = String("F:\For Cursor\revit-face-opening-cbwd-bl")  # graph input
selectionMode = String("SelectedOnly")  # graph input
familyNameContains = String("Face Opening")  # graph input
parameterName = String("CBWD B.L.")  # graph input
# note: SelectionMode
reportPath = String("(auto)")  # graph input
run_sync_cbwd_b_l = PythonNode(IN[0]=projectRoot, IN[1]=selectionMode, IN[2]=familyNameContains, IN[3]=parameterName, IN[4]=reportPath)  # IronPython2
getItemAtIndex = List.GetItemAtIndex(list=run_sync_cbwd_b_l)
summary = Watch(getItemAtIndex)  # graph output
getItemAtIndex_2 = List.GetItemAtIndex(list=run_sync_cbwd_b_l)
reportPathOut = Watch(getItemAtIndex_2)  # graph output
getItemAtIndex_3 = List.GetItemAtIndex(list=run_sync_cbwd_b_l)
successCount = Watch(getItemAtIndex_3)  # graph output
getItemAtIndex_4 = List.GetItemAtIndex(list=run_sync_cbwd_b_l)
skippedCount = Watch(getItemAtIndex_4)  # graph output
getItemAtIndex_5 = List.GetItemAtIndex(list=run_sync_cbwd_b_l)
warnings = Watch(getItemAtIndex_5)  # graph output
getItemAtIndex_6 = List.GetItemAtIndex(list=run_sync_cbwd_b_l)
status = Watch(getItemAtIndex_6)  # graph output
